# Dynamo graph getFamilyParam18.dyn (Dynamo 1.3.4.6666)

file_path = Filename(".\paramList.xlsm")
code_block = CodeBlock { "INSTANCE"; 1; 0; }
family_types = FamilyTypes("M-Blower Coil Unit_Magicaire DUC Series:DUC06")
all_elements_of_family_type = ElementsOfFamilyType(family_types)
parameters = Element.Parameters(all_elements_of_family_type)
python_script = Python(IN[0]=parameters)
# ---------- python_script.python (6 lines) ----------
paramList = []

for param in IN[0][0]:
	paramList.append([str(param).split(" : ")[0], str(param).split(" : ")[1]])

OUT = paramList
# ----------------------------------------
writeToFile = Excel.WriteToFile(filePath=file_path, sheetName=code_block.out0, startRow=code_block.out1, startCol=code_block.out2, data=python_script)
file_path_2 = Filename(".\paramList.xlsm")
code_block_2 = CodeBlock { "TYPE"; 1; 0; }
type = FamilyInstance.Type(all_elements_of_family_type)
parameters_2 = Element.Parameters(type)
python_script_2 = Python(IN[0]=parameters_2)  # same code as python_script
writeToFile_2 = Excel.WriteToFile(filePath=file_path_2, sheetName=code_block_2.out0, startRow=code_block_2.out1, startCol=code_block_2.out2, data=python_script_2)
