# Dynamo graph instanceToType.dyn (Dynamo 1.3.4.6666)

code_block = CodeBlock { {"Design Cooling Airflow", "Design Heating Airflow"}; }
boolean = BoolSelector(false)
familyParameters = Custom[FamilyDocument.FamilyParameters](toggle=boolean)  # Retrieves all family parameters from the active family document. PLEASE NOTE: This node will only work in a family document!
name = Custom[Element.Name+](element=familyParameters)  # Gets an element's name. Unlike the OOTB node, this node should work for all Revit elements that have names and will also return the localized names of system parameters, parameter groups, display unit types, parameter types, unit symbol types and unit types.
code_block_2 = CodeBlock { "Design Cooling Airflow"; }
indexOf = IndexOf(name, code_block_2)
getItemAtIndex = List.GetItemAtIndex(list=name, index=indexOf)
makeInstance = Custom[FamilyParameter.MakeInstance](familyParameter=getItemAtIndex)  # Converts a type parameter to an instance parameter. ATTENTION: Only works in a family document.
watch = Watch(makeInstance.familyParameter)
watch_2 = Watch(makeInstance.success)
makeType = Custom[FamilyParameter.MakeType]()  # Converts an instance parameter to a type parameter. ATTENTION: Only works in a family document.; unwired: familyParameter
