# Dynamo graph setFamilyParam18-2.dyn (Dynamo 1.3.4.6666)

family_types = FamilyTypes("M-FCU Horizontal Concealed_Trane FCCB040:FCU-04H")
all_elements_of_family_type = ElementsOfFamilyType(family_types)
type = FamilyInstance.Type(all_elements_of_family_type)
create = List.Create(all_elements_of_family_type, type)
setParameterByName = Element.SetParameterByName(element=create)  # unwired: parameterName, value
code_block = CodeBlock()
# ---------- code_block.designscript (2 lines) ----------
{"Design Cooling Airflow", "Design Cooling Entering Air DB Temperature", "Design Cooling Entering Air WB Temperature", "Design Cooling Entering Water Temperature", "Design Cooling Leaving Air DB Temperature", "Design Cooling Leaving Air WB Temperature", "Design Cooling Leaving Water Temperature", "Design Cooling Total Capacity", "Design Cooling Water Flow", "Design Cooling Water Pressure Drop", "Design Heating Entering Air DB Temperature", "Design Heating Entering Water Temperature", "Design Heating Leaving Air DB Temperature", "Design Heating Leaving Water Temperature", "Design Heating Total Capacity", "Design Heating Water Flow", "Design Heating Water Pressure Drop", "Design Maximum Overcurrent Protection (MOCP)", "Design Maximum Supply Airflow", "Design Maximum Weight"};
{250,1.16063559597977, 1.13458658041548, 0.997829248702976, 1.11070831614822, 1.11070831614822, 1.11070831614822, 7.7,2,1.75,1.14978183949465, 1.30173443028632, 1.19753836802917, 1.23661189137561, 6.1,0,0.25,15,250,109};
# ----------------------------------------
combine = List.Combine(setParameterByName, code_block.out0, code_block.out1)
