# Dynamo graph setMark.dyn (Dynamo 1.3.4.6666)

views = Views("23 82 19 - 4-PIPE FAN COIL UNIT SCHEDULE")
boolean = BoolSelector(false)
currentSelection = Custom[Springs.Collector.CurrentSelection](refresh=boolean)  # Gets the currently selected elements. Connect a boolean switch to refresh the selection.
elementsByView = Custom[RIE.ElementsByView](Views=currentSelection)  # Selects elements that are visible in input view. Forked from Marc. Tags : Elements by view
flatten = Flatten(elementsByView)
type = FamilyInstance.Type(flatten)
code_block = CodeBlock { "2rw_Abbrv"; "2rw_Type"; }
getParameterValueByName = Element.GetParameterValueByName(element=type, parameterName=code_block.out0)
getParameterValueByName_2 = Element.GetParameterValueByName(element=type, parameterName=code_block.out1)
code_block_2 = CodeBlock { "2rw_Instance"; }
getParameterValueByName_3 = Element.GetParameterValueByName(element=flatten, parameterName=code_block_2)
python_script = Python(IN[0]=flatten, IN[1]=getParameterValueByName, IN[2]=getParameterValueByName_2, IN[3]=getParameterValueByName_3)
# ---------- python_script.python (20 lines) ----------
import clr

#Import the Revit API
clr.AddReference('RevitAPI')
import Autodesk
from Autodesk.Revit.DB import *

#Import DocumentManager and TransactionManager
clr.AddReference('RevitServices')
import RevitServices
from RevitServices.Persistence import DocumentManager
from RevitServices.Transactions import TransactionManager

mark = []

for i in range(0, len(IN[0])):
	mark.append(IN[1][i] + "-" + IN[2][i] + "-" + IN[3][i])
	IN[0][i].SetParameterByName("Mark", IN[1][i] + "-" + IN[2][i] + "-" + IN[3][i])

OUT = mark
# ----------------------------------------
